# Dynamo custom node Create_Assembly_Views.dyf (Dynamo 2.6.2.15705)
# category: LIVIO
# To Create Assembly views and schedule and also applied view templates

Assemblies_List = Input(Assemblies_List: var[]..[])
code_block = CodeBlock(item=Assemblies_List) { DSCore.List.Flatten([item]); }
Ortho3D = Input(Ortho3D: bool = false)
PlanView = Input(PlanView: bool = false)
ElevationTop = Input(ElevationTop: bool = false)
ElevationBottom = Input(ElevationBottom: bool = false)
ElevationLeft = Input(ElevationLeft: bool = false)
ElevationRight = Input(ElevationRight: bool = false)
ElevationFront = Input(ElevationFront: bool = false)
ElevationBack = Input(ElevationBack: bool = false)
PartList = Input(PartList: bool = false)
DetailSectionA = Input(DetailSectionA: bool = false)
DetailSectionB = Input(DetailSectionB: bool = false)
CreateSheet = Input(CreateSheet: bool = false)
TitleBlockType = Input(TitleBlockType: var[]..[])
StructuralSchedule = Input(StructuralSchedule: bool = false)
Schedule_View_Template = Input(Schedule_View_Template: var[]..[])
View_Template = Input(View_Template: var[]..[])
python_script = Python(IN[0]=code_block, IN[1]=Ortho3D, IN[2]=PlanView, IN[3]=ElevationTop, IN[4]=ElevationBottom, IN[5]=ElevationLeft, IN[6]=ElevationRight, IN[7]=ElevationFront, IN[8]=ElevationBack, IN[9]=PartList, IN[10]=DetailSectionA, IN[11]=DetailSectionB, IN[12]=CreateSheet, IN[13]=TitleBlockType, IN[14]=StructuralSchedule, IN[15]=Schedule_View_Template, IN[16]=View_Template)
# ---------- python_script.python (125 lines) ----------
#python nodes in dynamo 1.0
#proposed by Julien Benoit @jbenoit44 
#http://aecuandme.wordpress.com/
import clr
clr.AddReference('ProtoGeometry')
from Autodesk.DesignScript.Geometry import *
# Import ToDSType(bool) extension method
clr.AddReference("RevitNodes")
import Revit
clr.ImportExtensions(Revit.Elements)
# Import geometry conversion extension methods
clr.ImportExtensions(Revit.GeometryConversion)
# Import DocumentManager and TransactionManager
clr.AddReference("RevitServices")
import RevitServices
from RevitServices.Persistence import DocumentManager
from RevitServices.Transactions import TransactionManager
from System.Collections.Generic import *
# Import RevitAPI
clr.AddReference("RevitAPI")
import Autodesk
from Autodesk.Revit.DB import *

doc = DocumentManager.Instance.CurrentDBDocument
uiapp = DocumentManager.Instance.CurrentUIApplication
app = uiapp.Application
uidoc=DocumentManager.Instance.CurrentUIApplication.ActiveUIDocument


# View Temp ID
schedule_View_Template_Id = UnwrapElement(IN[15][0]).Id

viewTemplateId = UnwrapElement(IN[16][0]).Id

elt = []
for i in IN[0]:
	elt.append(UnwrapElement(i).Id)
	
tb=UnwrapElement(IN[13]).Id
	
catid=doc.GetElement(elt[0]).Category.Id
	
collection=List[ElementId](elt)
viewlist=[]
sheetlist=[]
# Start Transaction
TransactionManager.Instance.EnsureInTransaction(doc)
for a in elt:
	views=[]
	if IN[1] == 1:
		v = AssemblyViewUtils.Create3DOrthographic(doc, a)		
		views.append(v)
	if IN[2] == 1:	
		ds2=AssemblyViewUtils.CreateDetailSection(doc,a,AssemblyDetailViewOrientation.HorizontalDetail)
		# Apply view template to the view
		ds2.ViewTemplateId = viewTemplateId
		views.append(ds2)
	if IN[3] == 1:	
		ds3=AssemblyViewUtils.CreateDetailSection(doc,a,AssemblyDetailViewOrientation.ElevationTop)
		# Apply view template to the view
		ds3.ViewTemplateId = viewTemplateId
		views.append(ds3)
	if IN[4] == 1:	
		ds4=AssemblyViewUtils.CreateDetailSection(doc,a,AssemblyDetailViewOrientation.ElevationBottom)
		# Apply view template to the view
		ds4.ViewTemplateId = viewTemplateId
		views.append(ds4)
	if IN[5] == 1:	
		ds5=AssemblyViewUtils.CreateDetailSection(doc,a,AssemblyDetailViewOrientation.ElevationLeft)
		# Apply view template to the view
		ds5.ViewTemplateId = viewTemplateId
		views.append(ds5)
	if IN[6] == 1:	
		ds6=AssemblyViewUtils.CreateDetailSection(doc,a,AssemblyDetailViewOrientation.ElevationRight)
		# Apply view template to the view
		ds6.ViewTemplateId = viewTemplateId
		views.append(ds6)
	if IN[7] == 1:	
		ds7=AssemblyViewUtils.CreateDetailSection(doc,a,AssemblyDetailViewOrientation.ElevationFront)
		# Apply view template to the view
		ds7.ViewTemplateId = viewTemplateId
		views.append(ds7)
	if IN[8] == 1:	
		ds8=AssemblyViewUtils.CreateDetailSection(doc,a,AssemblyDetailViewOrientation.ElevationBack)
		# Apply view template to the view
		ds8.ViewTemplateId = viewTemplateId
		views.append(ds8)
	if IN[9] == 1:	
		ds9=AssemblyViewUtils.CreatePartList(doc,a)
		# Apply view template to the view
		ds9.ViewTemplateId = viewTemplateId
		views.append(ds9)
	if IN[10] == 1:	
		ds10=AssemblyViewUtils.CreateDetailSection(doc,a,AssemblyDetailViewOrientation.DetailSectionA)
		# Apply view template to the view
		ds10.ViewTemplateId = viewTemplateId
		views.append(ds10)
	if IN[11] == 1:	
		ds11=AssemblyViewUtils.CreateDetailSection(doc,a,AssemblyDetailViewOrientation.DetailSectionB)
		# Apply view template to the view
		ds11.ViewTemplateId = viewTemplateId
		views.append(ds11)
	
	if IN[12] == 1:
		sh=AssemblyViewUtils.CreateSheet(doc,a,tb)
		for v in views:
			if Viewport.CanAddViewToSheet(doc,sh.Id,v.Id) == 1:
				Viewport.Create(doc,sh.Id,v.Id,XYZ(0,0,0))
			else:
				ScheduleSheetInstance.Create(doc,sh.Id,v.Id,XYZ(0,0,0))
		sheetlist.append(sh)
	if IN[14] == 1:
		# Get the structural Framing Category Id 
		structuralFramingCategoryId = Category.GetCategory(doc, BuiltInCategory.OST_StructuralFraming).Id
		
		# Create a single category schedule for the assembly element with view template
		sched = AssemblyViewUtils.CreateSingleCategorySchedule(doc, a, structuralFramingCategoryId, schedule_View_Template_Id, True)
		views.append(sched)
	viewlist.append(views)
		
doc.Regenerate()
# End Transaction
TransactionManager.Instance.TransactionTaskDone()

OUT=viewlist,sheetlist
# ----------------------------------------
code_block_2 = CodeBlock(a=python_script) { a[0]; a[1]; }
All_Sheets = Output(code_block_2.out1)
List_Of_Views = Output(code_block_2.out0)
