# Dynamo custom node Opening_To_Curves.dyf (Dynamo 2.6.2.15705)
# category: LIVIO
# This node will convert openings to polycurves / curves

Openings = Input(Openings: var[]..[])  # elements
python_script = Python(IN[0]=Openings)
# ---------- python_script.python (35 lines) ----------
import clr
from System.Collections.Generic import List

# Load Revit API
clr.AddReference('RevitAPI')
from Autodesk.Revit.DB import *
from Autodesk.Revit.DB.Structure import *
from Autodesk.Revit.Creation import *

# Load Revit Nodes
clr.AddReference('RevitNodes')
import Revit
clr.ImportExtensions(Revit.GeometryConversion)
clr.ImportExtensions(Revit.Elements)
from Revit.Elements import *

# Load Revit Services
clr.AddReference('RevitServices')
import RevitServices
from RevitServices.Persistence import DocumentManager
from RevitServices.Transactions import TransactionManager

# The inputs to this node will be stored as a list in the IN variables.
if isinstance(IN[0],list):
	openings = UnwrapElement(IN[0])
else:
	openings = [UnwrapElement(IN[0])]

curves = []
# Place your code below this line
for opening in openings:
	
	curves.append(opening.BoundaryCurves.ToProtoType())
# Assign your output to the OUT variable.
OUT = curves
# ----------------------------------------
OUT = Output(python_script)
