# Dynamo custom node Openings_From_Elements.dyf (Dynamo 2.6.2.15705)
# category: LIVIO
# This node will get all the structural openings from elements

elements = Input(elements: var[]..[])  # elements
python_script = Python(IN[0]=elements)
# ---------- python_script.python (42 lines) ----------
import clr
from System.Collections.Generic import List

# Load Revit API
clr.AddReference('RevitAPI')
from Autodesk.Revit.DB import *
from Autodesk.Revit.DB.Structure import *
from Autodesk.Revit.Creation import *

# Load Revit Nodes
clr.AddReference('RevitNodes')
import Revit
clr.ImportExtensions(Revit.GeometryConversion)
clr.ImportExtensions(Revit.Elements)

# Load Revit Services
clr.AddReference('RevitServices')
import RevitServices
from RevitServices.Persistence import DocumentManager
from RevitServices.Transactions import TransactionManager

# The inputs to this node will be stored as a list in the IN variables.
elements = IN[0]
if isinstance(elements, list):
    elements = [UnwrapElement(elem) for elem in elements]
else:
    elements = [UnwrapElement(elements)]

doc = DocumentManager.Instance.CurrentDBDocument

# Create ElementClassFilter for Openings
classFilter = ElementClassFilter(Opening)

# Place your code below this line

# Get dependent elements using LINQ in Python
openings = []
for element in elements:
    openings.append([doc.GetElement(x) for x in element.GetDependentElements(classFilter)])
	
# Assign your output to the OUT variable.
OUT = openings
# ----------------------------------------
OUT = Output(python_script)
