# Dynamo custom node Place_Views_on_Sheets.dyf "Place_Views_ON_Sheets" (Dynamo 2.6.2.15705)
# category: LIVIO
# Place views and schedule on sheets

Views_and_Schedule = Input(Views_and_Schedule: var[]..[])
All_Sheets = Input(All_Sheets: var[]..[])
location = Input(location: var[]..[])
Refresh = Input(Refresh: bool = true)
place_legend_schedule_on_sheet_s = Python(IN[0]=Views_and_Schedule, IN[1]=All_Sheets, IN[2]=location, IN[3]=Refresh)  # "Place Legend/Schedule On Sheet(s) (py)"
# ---------- place_legend_schedule_on_sheet_s.python (65 lines) ----------
import clr

clr.AddReference("RevitServices")
import RevitServices 
from RevitServices.Persistence import DocumentManager
from RevitServices.Transactions import TransactionManager
doc = DocumentManager.Instance.CurrentDBDocument
uidoc = DocumentManager.Instance.CurrentUIDocument
clr.AddReference("RevitNodes")
import Revit
clr.ImportExtensions(Revit.Elements)
clr.ImportExtensions(Revit.GeometryConversion)
clr.AddReference("RevitAPI")
from Autodesk.Revit.DB import *
from Autodesk.Revit.DB.Electrical import PanelScheduleSheetInstance as pssi
clr.AddReference("RevitAPIUI")
from Autodesk.Revit.UI import *

def tolist(obj1):
	if hasattr(obj1,"__iter__"): return obj1
	else: return [obj1]

views = tolist(IN[0])
sheets = tolist(IN[1])
locs = tolist(IN[2])
viewports = []
failed = []

i = 0;
if len(views) == len(locs):
	for v in views:
		loc = XYZ(locs[i].X, locs[i].Y, locs[i].Z)
		view = UnwrapElement(v)
		for vs in sheets:
			sheet = UnwrapElement(vs)
			canAddToSht = True;
			if view.ViewType != ViewType.Schedule and view.ViewType != ViewType.PanelSchedule:				
				canAddToSht = Viewport.CanAddViewToSheet(doc, sheet.Id, view.Id)								
			if canAddToSht:				
				try:
					if view.ViewType == ViewType.Schedule:
						TransactionManager.Instance.EnsureInTransaction(doc)	
						viewport = ScheduleSheetInstance.Create(doc, sheet.Id, view.Id, loc)	
						TransactionManager.Instance.TransactionTaskDone()
						viewports.Add([viewport,sheet])
					elif view.ViewType == ViewType.PanelSchedule:				
						TransactionManager.Instance.EnsureInTransaction(doc)	
						viewport = pssi.Create(doc, view.Id, sheet)
						viewport.Origin = loc
						
						TransactionManager.Instance.TransactionTaskDone()
						viewports.Add([viewport,sheet])
					else:
						TransactionManager.Instance.EnsureInTransaction(doc)	
						viewport = Viewport.Create(doc, sheet.Id, view.Id, loc)	
						TransactionManager.Instance.TransactionTaskDone()
						viewports.Add([viewport,sheet])
				except Exception, e:
					failed.Add([str(e),sheet])
			else:
				failed.Add(["Failed",sheet])
		i = i+1
	OUT = [viewports, failed]
else:
	OUT = "Error! The number of views you want to place must match the number of Location Points"
# ----------------------------------------
OUT = Output(place_legend_schedule_on_sheet_s)
